# Grasshopper definition storytelling.gh (Grasshopper 1.0.7)
# plug-ins: Bifocals, Human, Geospatial, Urbano, Kangaroo2 Components

# ----
# EU NUTS 2
path = FilePath("C:\WORK_IAAC\submissions\Storytelling\fiesta_shapefiles\shp_export\Es_pro.geojson")
readjson = ReadGeoJSON(File=path)  # -> Type, simplify(Geometry), Keys, Values
meta = CreateMetadata(KeysInMetadata=readjson.Keys, ValuesInMetadata=simplify(readjson.Values))
branch = TreeBranch(Tree=simplify(readjson.Keys), Path="{0}", MaintainPaths=True)
panel = Panel(branch)
crv = Curve(readjson.Geometry)
item = ListItem(List=panel, Index=Slider(3, range=0..10), Wrap=True)

viewer = ParamViewer(readjson.Geometry)
path_mapper = PathMapper(readjson.Geometry, source=["{A}", "{A;B}"], target=["{A}", "{A}"])
viewer_2 = ParamViewer(path_mapper)
panel_2 = Panel(item)

lookup = LookupMetadata(MetadataGeometry=meta, SearchKey=panel_2)  # -> flatten(Value)
panel_3 = Panel(lookup)

explode = Explode(Curve=flatten(crv), Recursive=True)  # -> Segments, Vertices
mindex = MemberIndex(Set=lookup, Member="DE")  # -> Index, Count
dupln = RemoveDuplicateLines(Lines=flatten(explode.Segments), Tolerance=0.01)
previewlw = CustomPreviewLineweights(Geometry=dupln, Shader=ColourSwatch(SwatchColor=RGB(18, 13, 13)), Thickness=Slider(2, range=0..5), Absolute=False)
