# Grasshopper definition storytelling_cal.gh (Grasshopper 1.0.7)
# plug-ins: Human, Urbano, Wombat

date = ConstructDate(Year="2023", Month="01", Day="01", Hour="00", Minute="00", Second="00")
date_2 = ConstructDate(Year="2023", Month="12", Day="31", Hour="00", Minute="00", Second="00")
time = Time("now")

# ----
# all fiestas
path = FilePath("C:\WORK_IAAC\submissions\Storytelling\fiesta_shapefiles\fiestasAll_timeline.csv")
file = ReadFile(File=path, PerLineParse=True)

division = Division(A="365", B="14")
panel = Panel(time)
addition = Addition(A=division, B="1")
rdate = DateRange(TimeA=date, TimeB=date_2, Count="365")
split = TextSplit(Text=file, Separators=",")  # -> simplify(Result)
smtime = ConstructSmoothTime(Days="365", Hours=0, Minutes=0, Seconds=0)
panel_2 = Panel(rdate)
tstat = TreeStatistics(Tree=split)  # -> Paths, Length, Count
panel_3 = Panel(smtime)
ddate = DeconstructDate(Date=rdate)  # -> Year, Month, Day, Hour, Minute, Second
branch = TreeBranch(Tree=split, Path="{0}", MaintainPaths=True)
P = Plane(PlaneXY(0, 0, 0))
cull_i = CullIndex(List=tstat.Paths, Indices=0, Wrap=True)
branch_2 = TreeBranch(Tree=simplify(split), Path=cull_i, MaintainPaths=True)

# ----
# make branches by month
reldif = RelativeDifferences(Values=ddate.Day)
smaller = SmallerThan(FirstNumber=reldif, SecondNumber="0")  # -> SmallerThan, OrEqualTo
shift = ShiftList(List=smaller.OrEqualTo, Shift=1, Wrap=True)
cull = CullPattern(List=ddate.Day, CullPattern=shift)
partition = PartitionList(List=ddate.Day, Size=cull)  # -> simplify(Chunks)

# ----
# matrix of days. option 2
recgrid = Rectangular(Plane=P, SizeX="5", SizeY="5", ExtentX=division, ExtentY="14")  # -> Cells, Points
tstat_2 = TreeStatistics(Tree=recgrid.Cells)  # -> Paths, Length, Count
item = ListItem(List=flatten(branch), Index=Slider(3, range=0..12), Wrap=True)
swatch = ColourSwatch(SwatchColor=RGB(255, 255, 255))

# ----
# week days legend
panel_4 = Panel("""Mon
Tues
Wed
Thurs
Fri
Sat
Sun""")
shift_2 = ShiftList(List=panel_4, Shift=-1, Wrap=True)
panel_5 = Panel(shift_2)
merge = Merge(Data1=panel_5, Data2=panel_5)
item_2 = ListItem(List=tstat_2.Paths, Index=0, Wrap=True)
branch_3 = TreeBranch(Tree=recgrid.Cells, Path=item_2, MaintainPaths=True)
area = Area(Geometry=branch_3)  # -> Area, Centroid
X = UnitX(Factor=-5)
move = Move(Geometry=area.Centroid, Motion=X)  # -> Geometry, Transform
justified_text = JustifiedText3d(
    Location=move.Geometry,
    Text=merge,
    Size=2,
    Color=swatch,
    HorizontalAlignment=2,
    VerticalAlginment=1,
    UseMeshes=False,
    Bake=False)

meta = CreateMetadata(KeysInMetadata=branch, ValuesInMetadata=branch_2)
rec = Rectangle(flatten(recgrid.Cells))
item_3 = ListItem(List=flatten(branch), Index=Slider(2, range=0..12), Wrap=True)
graft = GraftTree(Tree=ddate.Day, IncludeEmptyLists=True, IncludeNullItems=True)  # -> simplify(Tree)
graft_2 = GraftTree(Tree=rec, IncludeEmptyLists=True, IncludeNullItems=True)  # -> simplify(Tree)
panel_6 = Panel(item)
panel_7 = Panel(item_3)

# ----
# remove last day 31.12
tstat_3 = TreeStatistics(Tree=graft)  # -> Paths, Length, Count
cull_i_2 = CullIndex(List=reverse(tstat_3.Paths), Indices=0, Wrap=True)
branch_4 = TreeBranch(Tree=graft, Path=cull_i_2, MaintainPaths=True)

area_2 = Area(Geometry=graft_2)  # -> Area, Centroid

# ----
# joined breps of months
partition_2 = PartitionList(List=rec, Size=cull)  # -> simplify(Chunks)
boundary = BoundarySurfaces(Edges=partition_2)
join = BrepJoin(Breps=boundary)  # -> flatten(Breps), Closed
lng = ListLength(List=flatten(join.Breps))

# ----
# geolocations
lookup = LookupMetadata(MetadataGeometry=meta, SearchKey=panel_6)  # -> flatten(Value)
lookup_2 = LookupMetadata(MetadataGeometry=meta, SearchKey=panel_7)  # -> flatten(Value)
construct_point = ConstructPoint(XCoordinate=lookup_2, YCoordinate=lookup, ZCoordinate=0)

panel_8 = Panel(partition)

# ----
# matrix of days. option 1
tstat_4 = TreeStatistics(Tree=partition)  # -> Paths, Length, Count
series = Series(Start=0, Step=expr("-x", "5"), Count=tstat_4.Count)
pt = ConstructPoint(XCoordinate=0, YCoordinate=series, ZCoordinate=0)
recgrid_2 = Rectangular(Plane=pt, SizeX="5", SizeY="5", ExtentX=tstat_4.Length, ExtentY="1")  # -> Cells, Points

panel_9 = Panel(partition_2)
edges = BrepEdges(Brep=join.Breps)  # -> Naked, Interior, NonManifold
concat = Concatenate(FragmentA="{", FragmentB=Slider(142, range=0..300), FragmentC="}")

# ----
# radius and increment
#  radius of circles in calendar
panel_10 = Panel("1")

bang = ExplodeTree(Data=partition_2)  # -> Branch0, Branch1, Branch2, Branch3, Branch4, Branch5, Branch6, Branch7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
correction_dec = Panel("""25
25
25
25
25
26
26
26
27
28
28
29
29
29
30
30
30
30
30
30
30""")

division_2 = Division(A="5", B=Slider(5, range=2..20))
cir = Circle(Plane=area_2.Centroid, Radius=division_2)

previewlw = CustomPreviewLineweights(Geometry=rec, Shader=ColourSwatch(SwatchColor=RGBA(103, 105, 168, 129)), Thickness="0.5", Absolute=False)

merge_2 = Merge(
    Data1=ColourSwatch(SwatchColor=RGB(6, 9, 255)),
    Data2=ColourSwatch(SwatchColor=RGB(44, 145, 255)),
    Data3=ColourSwatch(SwatchColor=RGB(47, 241, 255)),
    Data4=ColourSwatch(SwatchColor=RGB(80, 143, 0)),
    Data5=ColourSwatch(SwatchColor=RGB(53, 189, 150)),
    Data6=ColourSwatch(SwatchColor=RGB(133, 253, 134)),
    Data7=ColourSwatch(SwatchColor=RGB(247, 246, 32)),
    Data8=ColourSwatch(SwatchColor=RGB(253, 189, 46)),
    Data9=ColourSwatch(SwatchColor=RGB(255, 155, 102)),
    Data10=ColourSwatch(SwatchColor=RGB(250, 23, 39)),
    Data11=ColourSwatch(SwatchColor=RGB(255, 33, 233)),
    Data12=ColourSwatch(SwatchColor=RGB(196, 115, 255)))

# ----
# days
swatch_2 = ColourSwatch(SwatchColor=RGB(0, 3, 30))
justified_text_2 = JustifiedText3d(
    Location=area_2.Centroid,
    Text=branch_4,
    Size=1,
    Color=swatch_2,
    HorizontalAlignment=1,
    VerticalAlginment=1,
    UseMeshes=False,
    Bake=False)

swatch_3 = ColourSwatch(SwatchColor=RGB(15, 32, 68))
swatch_4 = ColourSwatch(SwatchColor=RGB(246, 246, 255))

# ----
# borders of months
swatch_5 = ColourSwatch(SwatchColor=RGB(54, 66, 30))
previewlw_2 = CustomPreviewLineweights(Geometry=edges.Naked, Shader=ColourSwatch(SwatchColor=RGB(246, 246, 255)), Thickness="3", Absolute=False)

alpha = AdjustAlpha(Color=ColourSwatch(SwatchColor=RGB(0, 0, 0)), Alpha=Slider(0, range=0..1.02))

# ----
# background of months
preview = CustomPreview(Geometry=join.Breps, Material=alpha)

# ----
# create ranges of days for each entry
number_slider = Slider(9, range=0..12)
item_4 = ListItem(List=branch, Index=[number_slider, Slider(8, range=0..12)], Wrap=True)
panel_11 = Panel(item_4)
lookup_3 = LookupMetadata(MetadataGeometry=meta, SearchKey=panel_11)  # -> simplify(Value)
dispatch = Dispatch(List=lookup_3, DispatchPattern=[True, False])  # -> ListA, ListB
split_2 = TextSplit(Text=dispatch.ListA, Separators="/")
split_3 = TextSplit(Text=dispatch.ListB, Separators="/")
item_5 = ListItem(List=split_2, Index=0, Wrap=True)  # -> flatten(Item), flatten(Item1), flatten(Item2)
item_6 = ListItem(List=split_3, Index=0, Wrap=True)  # -> flatten(Item), flatten(Item1), flatten(Item2)
date_3 = ConstructDate(Year="2023", Month=item_6.Item, Day=item_6.Item1, Hour="00", Minute="00", Second="00")
date_4 = ConstructDate(Year="2023", Month=item_5.Item, Day=item_5.Item1, Hour="00", Minute="00", Second="00")

python = GhPythonScript(D1=date_3, D2=date_4)  # -> out, d
# ---------- python: Python ----------
if __name__ == "__main__":
    delta = D2 - D1

    d = delta.Days
# ---------- end python ----------
days = Panel(python.d)

# ----
# number of days
panel_12 = Panel("2")
addition_2 = Addition(A=python.d, B=panel_12)

rdate_2 = DateRange(TimeA=date_3, TimeB=date_4, Count=addition_2)  # -> simplify(Range)
ddate_2 = DeconstructDate(Date=rdate_2)  # -> Year, Month, Day, Hour, Minute, Second

# ----
# dispatch days per each month
cset = CreateSet(List=flatten(ddate_2.Month))  # -> Set, Map
replace = ReplaceMembers(Set=cset.Set, Find=12, Replace=0)
shift_3 = ShiftList(List=replace, Shift=-1, Wrap=True)
bang_2 = ExplodeTree(Data=graft(shift_3))  # -> Branch0, Branch1, Branch2, Branch3, Branch4, Branch5, Branch6, Branch7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

# ----
# reduce first proxies
cull_i_3 = CullIndex(List=ddate_2.Day, Indices=0, Wrap=True)
cull_i_4 = CullIndex(List=ddate_2.Month, Indices=0, Wrap=True)

branch_5 = TreeBranch(Tree=simplify(ddate_2.Day), Path=concat, MaintainPaths=True)
branch_6 = TreeBranch(Tree=simplify(ddate_2.Month), Path=concat, MaintainPaths=True)
panel_13 = Panel(branch_6)
meta_2 = CreateMetadata(KeysInMetadata=cull_i_4, ValuesInMetadata=cull_i_3)

item_7 = ListItem(List=flatten(cset.Set), Index=bang_2.Branch4, Wrap=True)
item_8 = ListItem(List=flatten(cset.Set), Index=bang_2.Branch5, Wrap=True)
item_9 = ListItem(List=flatten(cset.Set), Index=bang_2.Branch0, Wrap=True)
item_10 = ListItem(List=flatten(cset.Set), Index=bang_2.Branch1, Wrap=True)
item_11 = ListItem(List=flatten(cset.Set), Index=bang_2.Branch2, Wrap=True)
item_12 = ListItem(List=flatten(cset.Set), Index=bang_2.Branch3, Wrap=True)

item_13 = ListItem(List=flatten(cset.Set), Index=bang_2.Branch6, Wrap=True)
item_14 = ListItem(List=flatten(cset.Set), Index=bang_2.Branch7, Wrap=True)
item_15 = ListItem(List=flatten(cset.Set), Index=bang_2.Branch8, Wrap=True)
item_16 = ListItem(List=flatten(cset.Set), Index=bang_2.Branch9, Wrap=True)
item_17 = ListItem(List=flatten(cset.Set), Index=bang_2.Branch10, Wrap=True)
item_18 = ListItem(List=flatten(cset.Set), Index=bang_2.Branch11, Wrap=True)

panel_14 = Panel(branch_5)
panel_15 = Panel(item_9)

lookup_4 = LookupMetadata(MetadataGeometry=meta_2, SearchKey=item_14)
clean = CleanTree(RemoveNulls=True, RemoveInvalid=True, RemoveEmpty=False, Tree=lookup_4)  # -> flatten(Tree)
sort = SortList(Keys=clean)  # -> Keys, ValuesA
panel_16 = Panel(sort.Keys)
cset_2 = CreateSet(List=panel_16)  # -> Set, Map
equals = Equality(FirstNumber=graft(cset_2.Set), SecondNumber=panel_16)  # -> Equality, Inequality
cull_2 = CullPattern(List=panel_16, CullPattern=equals.Equality)
lng_2 = ListLength(List=cull_2)
series_2 = Series(Start=panel_10, Step="0.3", Count=lng_2)

lookup_5 = LookupMetadata(MetadataGeometry=meta_2, SearchKey=item_15)
clean_2 = CleanTree(RemoveNulls=True, RemoveInvalid=True, RemoveEmpty=False, Tree=lookup_5)  # -> flatten(Tree)
sort_2 = SortList(Keys=clean_2)  # -> Keys, ValuesA
panel_17 = Panel(sort_2.Keys)
cset_3 = CreateSet(List=panel_17)  # -> Set, Map
equals_2 = Equality(FirstNumber=graft(cset_3.Set), SecondNumber=panel_17)  # -> Equality, Inequality
cull_3 = CullPattern(List=panel_17, CullPattern=equals_2.Equality)
lng_3 = ListLength(List=cull_3)
series_3 = Series(Start=panel_10, Step="0.3", Count=lng_3)

lookup_6 = LookupMetadata(MetadataGeometry=meta_2, SearchKey=item_16)
clean_3 = CleanTree(RemoveNulls=True, RemoveInvalid=True, RemoveEmpty=False, Tree=lookup_6)  # -> flatten(Tree)
sort_3 = SortList(Keys=clean_3)  # -> Keys, ValuesA
panel_18 = Panel(sort_3.Keys)
cset_4 = CreateSet(List=panel_18)  # -> Set, Map
equals_3 = Equality(FirstNumber=graft(cset_4.Set), SecondNumber=panel_18)  # -> Equality, Inequality
cull_4 = CullPattern(List=panel_18, CullPattern=equals_3.Equality)
lng_4 = ListLength(List=cull_4)
series_4 = Series(Start=panel_10, Step="0.3", Count=lng_4)

lookup_7 = LookupMetadata(MetadataGeometry=meta_2, SearchKey=item_17)
clean_4 = CleanTree(RemoveNulls=True, RemoveInvalid=True, RemoveEmpty=False, Tree=lookup_7)  # -> flatten(Tree)
sort_4 = SortList(Keys=clean_4)  # -> Keys, ValuesA
panel_19 = Panel(sort_4.Keys)
cset_5 = CreateSet(List=panel_19)  # -> Set, Map
equals_4 = Equality(FirstNumber=graft(cset_5.Set), SecondNumber=panel_19)  # -> Equality, Inequality
cull_5 = CullPattern(List=panel_19, CullPattern=equals_4.Equality)
lng_5 = ListLength(List=cull_5)
series_5 = Series(Start=panel_10, Step="0.3", Count=lng_5)

lookup_8 = LookupMetadata(MetadataGeometry=meta_2, SearchKey=item_13)
clean_5 = CleanTree(RemoveNulls=True, RemoveInvalid=True, RemoveEmpty=False, Tree=lookup_8)  # -> flatten(Tree)
sort_5 = SortList(Keys=clean_5)  # -> Keys, ValuesA
panel_20 = Panel(sort_5.Keys)
cset_6 = CreateSet(List=panel_20)  # -> Set, Map
equals_5 = Equality(FirstNumber=graft(cset_6.Set), SecondNumber=panel_20)  # -> Equality, Inequality
cull_6 = CullPattern(List=panel_20, CullPattern=equals_5.Equality)
lng_6 = ListLength(List=cull_6)
series_6 = Series(Start=panel_10, Step="0.3", Count=lng_6)

lookup_9 = LookupMetadata(MetadataGeometry=meta_2, SearchKey=item_7)
clean_6 = CleanTree(RemoveNulls=True, RemoveInvalid=True, RemoveEmpty=False, Tree=lookup_9)  # -> flatten(Tree)
sort_6 = SortList(Keys=clean_6)  # -> Keys, ValuesA
panel_21 = Panel(sort_6.Keys)

lookup_10 = LookupMetadata(MetadataGeometry=meta_2, SearchKey=panel_15)
clean_7 = CleanTree(RemoveNulls=True, RemoveInvalid=True, RemoveEmpty=False, Tree=lookup_10)  # -> flatten(Tree)
sort_7 = SortList(Keys=clean_7)  # -> Keys, ValuesA
panel_22 = Panel(sort_7.Keys)

lookup_11 = LookupMetadata(MetadataGeometry=meta_2, SearchKey=item_10)
clean_8 = CleanTree(RemoveNulls=True, RemoveInvalid=True, RemoveEmpty=False, Tree=lookup_11)  # -> flatten(Tree)
sort_8 = SortList(Keys=clean_8)  # -> Keys, ValuesA
panel_23 = Panel(sort_8.Keys)

lookup_12 = LookupMetadata(MetadataGeometry=meta_2, SearchKey=item_12)
clean_9 = CleanTree(RemoveNulls=True, RemoveInvalid=True, RemoveEmpty=False, Tree=lookup_12)  # -> flatten(Tree)
sort_9 = SortList(Keys=clean_9)  # -> Keys, ValuesA
panel_24 = Panel(sort_9.Keys)

lookup_13 = LookupMetadata(MetadataGeometry=meta_2, SearchKey=item_8)
clean_10 = CleanTree(RemoveNulls=True, RemoveInvalid=True, RemoveEmpty=False, Tree=lookup_13)  # -> flatten(Tree)
sort_10 = SortList(Keys=clean_10)  # -> Keys, ValuesA
panel_25 = Panel(sort_10.Keys)

lookup_14 = LookupMetadata(MetadataGeometry=meta_2, SearchKey=item_11)
clean_11 = CleanTree(RemoveNulls=True, RemoveInvalid=True, RemoveEmpty=False, Tree=lookup_14)  # -> flatten(Tree)
sort_11 = SortList(Keys=clean_11)  # -> Keys, ValuesA
panel_26 = Panel(sort_11.Keys)

lng_7 = ListLength(List=sort_11.Keys)
panel_27 = Panel(lng_7)

lng_8 = ListLength(List=sort_6.Keys)
panel_28 = Panel(lng_8)

lng_9 = ListLength(List=sort_8.Keys)
panel_29 = Panel(lng_9)

lng_10 = ListLength(List=sort_9.Keys)
panel_30 = Panel(lng_10)

lng_11 = ListLength(List=sort_10.Keys)
panel_31 = Panel(lng_11)

lng_12 = ListLength(List=sort_7.Keys)
panel_32 = Panel(lng_12)

cset_7 = CreateSet(List=panel_22)  # -> Set, Map
cset_8 = CreateSet(List=panel_23)  # -> Set, Map
cset_9 = CreateSet(List=panel_26)  # -> Set, Map
cset_10 = CreateSet(List=panel_24)  # -> Set, Map
cset_11 = CreateSet(List=panel_21)  # -> Set, Map
cset_12 = CreateSet(List=panel_25)  # -> Set, Map
equals_6 = Equality(FirstNumber=graft(cset_7.Set), SecondNumber=panel_22)  # -> Equality, Inequality
equals_7 = Equality(FirstNumber=graft(cset_8.Set), SecondNumber=panel_23)  # -> Equality, Inequality
equals_8 = Equality(FirstNumber=graft(cset_9.Set), SecondNumber=panel_26)  # -> Equality, Inequality
equals_9 = Equality(FirstNumber=graft(cset_10.Set), SecondNumber=panel_24)  # -> Equality, Inequality
equals_10 = Equality(FirstNumber=graft(cset_11.Set), SecondNumber=panel_21)  # -> Equality, Inequality
equals_11 = Equality(FirstNumber=graft(cset_12.Set), SecondNumber=panel_25)  # -> Equality, Inequality
cull_7 = CullPattern(List=panel_22, CullPattern=equals_6.Equality)
cull_8 = CullPattern(List=panel_23, CullPattern=equals_7.Equality)
cull_9 = CullPattern(List=panel_26, CullPattern=equals_8.Equality)
cull_10 = CullPattern(List=panel_24, CullPattern=equals_9.Equality)
cull_11 = CullPattern(List=panel_21, CullPattern=equals_10.Equality)
panel_33 = Panel(cull_7)
cull_12 = CullPattern(List=panel_25, CullPattern=equals_11.Equality)

item_19 = ListItem(List=flatten(bang.Branch4), Index=cull_11, Wrap=True)
item_20 = ListItem(List=flatten(bang.Branch1), Index=cull_8, Wrap=True)
item_21 = ListItem(List=flatten(bang.Branch2), Index=cull_9, Wrap=True)
item_22 = ListItem(List=flatten(bang.Branch0), Index=panel_33, Wrap=True)
item_23 = ListItem(List=flatten(bang.Branch3), Index=cull_10, Wrap=True)
item_24 = ListItem(List=flatten(bang.Branch5), Index=cull_12, Wrap=True)
area_3 = Area(Geometry=item_24)  # -> Area, Centroid
area_4 = Area(Geometry=item_22)  # -> Area, Centroid
area_5 = Area(Geometry=item_20)  # -> Area, Centroid
area_6 = Area(Geometry=item_23)  # -> Area, Centroid
area_7 = Area(Geometry=item_21)  # -> Area, Centroid
area_8 = Area(Geometry=item_19)  # -> Area, Centroid

lng_13 = ListLength(List=cull_8)
lng_14 = ListLength(List=cull_9)
lng_15 = ListLength(List=cull_10)
lng_16 = ListLength(List=cull_11)
lng_17 = ListLength(List=cull_12)
series_7 = Series(Start=panel_10, Step="0.3", Count=lng_13)
series_8 = Series(Start=panel_10, Step="0.3", Count=lng_14)
lng_18 = ListLength(List=panel_33)
series_9 = Series(Start=panel_10, Step="0.3", Count=lng_15)
series_10 = Series(Start=panel_10, Step="0.3", Count=lng_16)
series_11 = Series(Start=panel_10, Step="0.3", Count=lng_17)
panel_34 = Panel(lng_18)
series_12 = Series(Start=panel_10, Step="0.3", Count=panel_34)
panel_35 = Panel(series_12)

cir_2 = Circle(Plane=area_6.Centroid, Radius=series_9)
cir_3 = Circle(Plane=area_8.Centroid, Radius=series_10)
cir_4 = Circle(Plane=area_7.Centroid, Radius=series_8)
cir_5 = Circle(Plane=area_3.Centroid, Radius=series_11)
cir_6 = Circle(Plane=area_5.Centroid, Radius=series_7)
cir_7 = Circle(Plane=area_4.Centroid, Radius=panel_35)

box_corners = BoxCorners(Box=join.Breps)  # -> CornerA, CornerB, CornerC, CornerD, CornerE, CornerF, CornerG, CornerH
panel_36 = Panel("""JAN
FEB
MAR
APR
MAY
JUN
JUL
AUG
SEP
OCT
NOV
DEC""")

# ----
# months legend
Y = UnitY(Factor=3)
move_2 = Move(Geometry=box_corners.CornerD, Motion=Y)  # -> Geometry, Transform

justified_text_3 = JustifiedText3d(
    Location=move_2.Geometry,
    Text=panel_36,
    Size=2,
    Color=swatch,
    HorizontalAlignment=0,
    VerticalAlginment=1,
    UseMeshes=False,
    Bake=False)

lookup_15 = LookupMetadata(MetadataGeometry=meta_2, SearchKey=item_18)
clean_12 = CleanTree(RemoveNulls=True, RemoveInvalid=True, RemoveEmpty=False, Tree=lookup_15)  # -> flatten(Tree)
sort_12 = SortList(Keys=clean_12)  # -> Keys, ValuesA
panel_37 = Panel(sort_12.Keys)

merge_3 = Merge(Data1=panel_37, Data2=correction_dec)

cset_13 = CreateSet(List=merge_3)  # -> Set, Map
equals_12 = Equality(FirstNumber=graft(cset_13.Set), SecondNumber=merge_3)  # -> Equality, Inequality
cull_13 = CullPattern(List=merge_3, CullPattern=equals_12.Equality)
lng_19 = ListLength(List=cull_13)
series_13 = Series(Start=panel_10, Step="0.3", Count=lng_19)

item_25 = ListItem(List=flatten(bang.Branch9), Index=cull_4, Wrap=True)
item_26 = ListItem(List=flatten(bang.Branch10), Index=cull_5, Wrap=True)
item_27 = ListItem(List=flatten(bang.Branch11), Index=cull_13, Wrap=True)
item_28 = ListItem(List=flatten(bang.Branch8), Index=cull_3, Wrap=True)
item_29 = ListItem(List=flatten(bang.Branch7), Index=cull_2, Wrap=True)
item_30 = ListItem(List=flatten(bang.Branch6), Index=cull_6, Wrap=True)
area_9 = Area(Geometry=item_29)  # -> Area, Centroid
area_10 = Area(Geometry=item_25)  # -> Area, Centroid
area_11 = Area(Geometry=item_26)  # -> Area, Centroid
area_12 = Area(Geometry=item_27)  # -> Area, Centroid
area_13 = Area(Geometry=item_30)  # -> Area, Centroid
area_14 = Area(Geometry=item_28)  # -> Area, Centroid

cir_8 = Circle(Plane=area_9.Centroid, Radius=series_2)
cir_9 = Circle(Plane=area_10.Centroid, Radius=series_4)
cir_10 = Circle(Plane=area_11.Centroid, Radius=series_5)
cir_11 = Circle(Plane=area_13.Centroid, Radius=series_6)
cir_12 = Circle(Plane=area_12.Centroid, Radius=series_13)
cir_13 = Circle(Plane=area_14.Centroid, Radius=series_3)

merge_4 = Merge(
    Data1=cir_7,
    Data2=cir_6,
    Data3=cir_4,
    Data4=cir_2,
    Data5=cir_3,
    Data6=cir_5,
    Data7=cir_11,
    Data8=cir_8,
    Data9=cir_13,
    Data10=cir_9,
    Data11=cir_10,
    Data12=cir_12)
panel_38 = Panel(series_13)

# ----
# visualization of circles as festivals
number_slider_2 = Slider(0.08, range=0..1.02)
boundary_2 = BoundarySurfaces(Edges=[merge_4, cir])
alpha_2 = AdjustAlpha(Color=ColourSwatch(SwatchColor=RGB(253, 45, 70)), Alpha=number_slider_2)
preview_2 = CustomPreview(Geometry=boundary_2, Material=alpha_2)
